# Grasshopper definition Linked documents in a view.gh (Grasshopper 1.0.7)
# plug-ins: Rhino.Inside for Autodesk Revit

# ----
# ALL LINKS IN REVIT FILE
query_revit_links = QueryRevitLinks()  # -> Links, Documents

# ----
# ACTIVE VIEW
active_graphical_view = ActiveGraphicalView()

# ----
# LIST OF LINKS VISIBLE IN THE VIEW
# This is to get the list of elements visible in the view.
query_view_elements = QueryViewElements(View=active_graphical_view)

# ----
# REMOVING THE HIDDEN LINKS
# This is to get the names of the all the links in the file as a text.
text = Text(query_revit_links.Documents)
ghpython_script = GhPythonScript(links=text)  # -> links_names
# ---------- ghpython_script: Python ----------
# First the code deconstructs the name of the links removing the ":"
extract_link_names = links.split(" : ")

print (extract_link_names)

# Now the code gets only the part of the link that represents its name
char = ["."]
links_names = []

for t in extract_link_names:
    if all([c in t for c in char]):
        links_names.append(t)

print(links_names)
# ---------- end ghpython_script ----------

# ----
# This is to filter the visible links in the view
# (only rvt and ifc files)
panel = Panel("*Linked*")
match_text = MatchText(Text=query_view_elements, Pattern=panel, Case=True)
cull_pattern = CullPattern(List=query_view_elements, CullPattern=match_text)

# ----
# This is to get just the names of the links without the extensions.
panel_2 = Panel(".")
text_split = TextSplit(Text=ghpython_script, Separators=panel_2)
list_item = ListItem(List=text_split, Index="0", Wrap=True)
flatten_tree = FlattenTree(Tree=list_item, Path="{0}")

# ----
# This is to get the names of the links as a text.
text_2 = Text(cull_pattern)
ghpython_script_2 = GhPythonScript(links=text_2)  # -> links_names; same code as ghpython_script

# ----
# This is to discard the links that are not visible in the view.
find_similar_member = FindSimilarMember(Data=ghpython_script_2, Set=flatten_tree)  # -> Hit, Index
list_item_2 = ListItem(List=query_revit_links.Documents, Index=find_similar_member.Index, Wrap=True)

# ----
# GEOMETRY OF LINKS
# This is to get the elements from the visible links.
inspect_element = InspectElement(Element=active_graphical_view)
query_views = QueryViews(Document=list_item_2, ViewName=inspect_element, IsDependent=False, IsTemplate=False)
query_view_elements_2 = QueryViewElements(View=query_views)

# ----
# This is to discard the levels from the list of elements.
element_category = ElementCategory(Element=query_view_elements_2)  # -> Element, Category
element_name = ElementName(Element=element_category.Category)  # -> Element, Name
ghpython_script_3 = GhPythonScript(element_name=element_name.Name)  # -> out
# ---------- ghpython_script_3: Python ----------
if element_name == "Levels":
    print False
else:
    print True
# ---------- end ghpython_script_3 ----------
shift_paths = ShiftPaths(Data=ghpython_script_3, Offset="-1")
cull_pattern_2 = CullPattern(List=query_view_elements_2, CullPattern=shift_paths)
